# Grasshopper definition 250625_demo.gh (Grasshopper 1.0.8)
# plug-ins: Aggregations, Virtual Robot, Vizor

# ----
# Pre-defined Frames
number_slider = Slider(1.71, range=-1.71..1.71)
pt = Point(Point(-0.5739246967, 0.03830774993, 0.5250377575))
pt_2 = Point(Point(0.09840871164, -0.4383395091, 0.5250377575))
pt_3 = Point(<point referenced from the Rhino model>)
xy = XYPlane(Origin=pt)
xy_2 = XYPlane(Origin=pt_2)
rotate = Rotate(Geometry=xy, Angle=number_slider, Plane=xy)  # -> Geometry, Transform
xy_3 = XYPlane(Origin=pt_3)
rotate_2 = Rotate(Geometry=xy_2, Angle=Slider(3.14, range=0..10), Plane=xy_2)  # -> Geometry, Transform
flip_plane = FlipPlane(Plane=rotate.Geometry)
flip_plane_2 = FlipPlane(Plane=rotate_2.Geometry)

pflip = FlipPlane(Plane=rotate.Geometry, ReverseX=False, ReverseY=False, SwapAxes=True)
pflip_2 = FlipPlane(Plane=rotate_2.Geometry, ReverseX=False, ReverseY=False, SwapAxes=True)
merge = Merge(Data1=pflip, Data2=pflip_2)
pflip_3 = FlipPlane(Plane=xy_3, ReverseX=False, ReverseY=False, SwapAxes=True)

# ---- group: pick up position
flip_plane_3 = FlipPlane(Plane=xy_3)

# ---- group: home position
pln = Plane(merge)

# ----
# Docker Connection
button = Button()
wsstart = WsConnection(Address="ws://127.0.0.1:9090", Reset=button)

# ----
# Define Robot
pt_4 = Point(<point referenced from the Rhino model>)
xy_4 = XYPlane(Origin=pt_4)
brep = Brep([<brep referenced from the Rhino model> x3])
scale = Scale(Geometry=brep, Center=Point(0, 0, 0), Factor=1000)  # -> Geometry, Transform
scale_2 = Scale(Geometry=xy_4, Center=Point(0, 0, 0), Factor=1000)  # -> Geometry, Transform
end_effector = DefineEndEffector(Geometry=scale.Geometry, TCPFrame=scale_2.Geometry, MountingFrame=PlaneXY(0, 0, 0))
xy_5 = XYPlane(Origin=Point(0, 0, 0))
ur10 = PredefinedUniversalRobotUR10(BaseFrame=xy_5, EndEffectorOptional=end_effector)
links = Panel("""base_link
base_link_inertia
shoulder_link
upper_arm_link
forearm_link
wrist_1_link
wrist_2_link
wrist_3_link
flange
tool0
gripper_base
gripper_fingers
tcp""")
robot = Robot(
    WebsocketObject=wsstart,
    Disable=Button(),
    RobotName="UR10",
    VirtualRobotModelNS=ur10,
    AxisToggles=[False, False, False],
    LinkNames=links)  # -> Output, RobotObject

# ----
# Define Marker
panel = Panel("marker1")  # disabled
button_2 = Button()  # disabled
inputdevice = ARInputDevice(WebsocketObject=wsstart, Disable=button_2, DeviceName=panel)  # -> Output, ARDevice; disabled

# ----
# Define AR Clients
panel_2 = Panel("HOLO1")
hololens = Hololens(
    WebsocketObject=wsstart,
    Disable=Button(),
    DeviceName=panel_2,
    SkillConfiguration="{'robot-control': 1, 'screw': 1, 'pick-and-place': 1}")  # -> Output, ARDevice

# ----
# MCP Variables
scene_remove = BooleanToggle(False)
start_task = BooleanToggle(True)
scene_update = BooleanToggle(False)
actor_sequence = Panel("""H
R
R""")
cluster_id_0_3 = Panel("0")

# ----
# Geometry Input
brep_2 = Brep([<brep referenced from the Rhino model> x3])
brep_3 = Brep([<brep referenced from the Rhino model> x3])
num = Number(cluster_id_0_3)
brep_4 = Brep([<brep referenced from the Rhino model> x3])
brep_5 = Brep([<brep referenced from the Rhino model> x3])
cluster = Cluster_6(brep=brep_2)
cluster_2 = Cluster_5(brep=brep_3)
cluster_3 = Cluster_5(brep=brep_5)
cluster_4 = Cluster_6(brep=brep_4)
panel_3 = Panel("""01
02
03""")
filter = StreamFilter(Gate=num, Stream0=cluster_4, Stream1=cluster_3, Stream2=cluster, Stream3=cluster_2)
concat = Concatenate(FragmentA=num, FragmentB=panel_3)

click_this_to_start_robot = Button()
start = BooleanToggle(True)  # disabled

path_point = Slider(0.61, range=0.01..0.99)  # disabled
beam_index = Slider(1, range=0..2)  # disabled

item = ListItem(List=concat, Index=0, Wrap=True)  # -> Item, Item1, Item2
item_2 = ListItem(List=filter, Index=0, Wrap=True)  # -> Item, Item1, Item2

# ---- group: robot
data = Data(robot.RobotObject)

# ---- group: green A
brep_6 = Brep(item_2.Item)

# ---- group: red A
brep_7 = Brep(item_2.Item1)

# ---- group: blue A
brep_8 = Brep(item_2.Item2)

# ----
# MATERIAL PREP
merge_2 = Merge(Data1=flatten(cluster_4), Data2=flatten(cluster_3), Data3=flatten(cluster), Data4=flatten(cluster_2))
cluster_5 = Cluster_7(B=merge_2)  # -> pl_2, line_2
line = Line(cluster_5.line_2)
vec = Vector(line)
pt_5 = Point(<point referenced from the Rhino model>)
expression = Expression(x=vec, Expression="x/2")
xy_6 = XYPlane(Origin=pt_5)
lng = ListLength(List=merge_2)
move = Move(Geometry=cluster_5.pl_2, Motion=expression)  # -> Geometry, Transform
len = Length(Curve=line)  # -> flatten(Length)
arrlinear = LinearArray(Geometry=xy_6, Direction="{0.1,0,0}", Count=lng)  # -> Geometry, Transform
ma = MassAddition(Input=flatten(len))  # -> Result, PartialResults
tag = TextTag(Location=cluster_5.pl_2, Text=len)
panel_4 = Panel(ma.Result)

merge_3 = Merge(Data1=graft(cluster_4), Data2=graft(cluster_3), Data3=graft(cluster), Data4=graft(cluster_2))

# ---- group: 3 x 3 = 9 tasks
cluster_6 = Cluster_4(brep=brep_6, txt=item.Item, data=robot.RobotObject, home=pln, pickplane=pflip_3, robot=ur10)
cluster_7 = Cluster_4(brep=brep_7, txt=item.Item1, data=robot.RobotObject, home=pln, pickplane=pflip_3, robot=ur10)
cluster_8 = Cluster_4(brep=brep_8, txt=item.Item2, data=robot.RobotObject, home=pln, pickplane=pflip_3, robot=ur10)
merge_4 = Merge(Data1=flatten(cluster_6), Data2=flatten(cluster_7), Data3=flatten(cluster_8))

# ----
# Task Execution
taskctrl = TaskController(Start=start_task, HRCTasks=cluster_6, GHControl=True)  # -> CurrentTask, ProcessLog
exec_mode = BooleanToggle(True)
simulate = SimulateDevice(
    NetworkDevice=hololens.ARDevice,
    TriggerAcknowledge=Button(),
    TriggerReject=False,
    TriggerPing=False,
    TriggerHelp=False,
    TaskID=0)
simulate_2 = SimulateDevice(
    NetworkDevice=robot.RobotObject,
    TriggerSuccess=Button(),
    TriggerError=False,
    TriggerPause=False,
    TriggerStop=False,
    TaskID=0)
panel_5 = Panel(taskctrl.ProcessLog)
panel_6 = Panel(simulate)

simulator = RobotSimulator(Robot=robot.RobotObject, RobotTask=taskctrl.CurrentTask, StepInterval=1000, Start=start)  # -> Output, CurrentTCP, CurrentGeometry, ExternalAxis; disabled
executor = RobotExecution(Robot=robot.RobotObject, RobotTask=taskctrl.CurrentTask, Start=click_this_to_start_robot, Physical=exec_mode)
panel_7 = Panel(executor)
data_2 = Data(hololens.ARDevice)

# ---- group: 3 x 1 = 3 tasks
# Scene Content
swatch = ColourSwatch(SwatchColor=RGB(181, 62, 53))
swatch_2 = ColourSwatch(SwatchColor=RGB(78, 169, 77))
swatch_3 = ColourSwatch(SwatchColor=RGB(23, 0, 212))
cluster_9 = Cluster(M=brep_6, txt=item.Item, col=swatch_2, data=data)  # -> M_2, content_2
cluster_10 = Cluster(M=brep_7, txt=item.Item1, col=swatch, data=data)  # -> M_2, content_2
cluster_11 = Cluster(M=brep_8, txt=item.Item2, col=swatch_3, data=data)  # -> M_2, content_2
human_task_name = Panel("""Beam 1 green
Beam 2 red
Beam 3 blue""")
merge_5 = Merge(Data1=cluster_9.content_2, Data2=cluster_10.content_2, Data3=cluster_11.content_2)
merge_6 = Merge(Data1=swatch_2, Data2=swatch, Data3=swatch_3)
flip = FlipMatrix(Data=merge_3)
task = ConstructTaskObject(TaskNames=human_task_name, TargetDevices=data_2, SceneContents=merge_5, AssociatedSkill="null", EstimatedDuration=60)  # -> Output, TaskObject
preview = CustomPreview(Geometry=flip, Material=merge_6)

# ----
orient = Orient(Geometry=merge_2, Source=flatten(move.Geometry), Target=arrlinear.Geometry)  # -> Geometry, Transform
tag_2 = TextTag(Location=arrlinear.Geometry, Text=flatten(len))

py3 = Python3Script(seq=actor_sequence)  # -> out, pattern; inputs seq: list of String
# ---------- py3: Python ----------
"""Grasshopper Script"""
# a = "Hello Python 3 in Grasshopper!"
# print(a)

pattern = []

print(len(seq))

for i in range (3):
    if seq[i] == "H":
        pattern.append(0)
    elif seq[i] == "R":
        pattern += [1,1,1]
    else:
        print (seq[i])
        raise TypeError("Actor is neither human or robot.")
# ---------- end py3 ----------
weave = Weave(Pattern=py3.pattern, Stream0=task.TaskObject, Stream1=merge_4, NullGaps=False)

# ----
# Scene Update
scene_model = XRSceneModel(
    GHControl=True,
    ARDevices=data_2,
    ContentObjects=flatten(merge_5),
    TriggerSend=scene_update,
    TriggerRemove=scene_remove,
    TimeDelay=100)
panel_8 = Panel(scene_model)

# ----
# DEBUG
item_3 = ListItem(List=filter, Index=beam_index, Wrap=True)  # disabled
brep_9 = Brep(item_3)  # disabled
data_3 = Data(robot.RobotObject)  # disabled
txt = Text(num)  # disabled
pln_2 = Plane(pflip_3)  # disabled
robot_trajectory = RobotTrajectory(pln_2=pln, pln=pln_2, brep=brep_9)  # -> R, R_2, R_3, pl_2; disabled
panel_9 = Panel("beam")  # disabled
cartesian = BooleanToggle(True)  # disabled
cluster_12 = Cluster_2(relay_3=data_3, relay=brep_9, relay_2=robot_trajectory.pl_2, B=pln_2)  # -> M_2, M_3, M; disabled
trajectory = RobotTrajectoryObject(TargetRobot=data_3, IsCartesian=cartesian, TCPFrames=robot_trajectory.R, TrajectoryWidth=0.01)  # -> Output, TrajectoryObject, TrajectoryMesh; disabled
trajectory_2 = RobotTrajectoryObject(TargetRobot=data_3, IsCartesian=cartesian, TCPFrames=robot_trajectory.R_2, TrajectoryWidth=0.01)  # -> Output, TrajectoryObject, TrajectoryMesh; disabled
trajectory_3 = RobotTrajectoryObject(TargetRobot=data_3, IsCartesian=cartesian, TCPFrames=robot_trajectory.R_3, TrajectoryWidth=0.01)  # -> Output, TrajectoryObject, TrajectoryMesh; disabled
content = ConstructSceneContent(Name="content object", Meshes=cluster_12.M_2, LevelOfDetail=0)  # disabled
content_2 = ConstructSceneContent(Name="content object", Meshes=cluster_12.M_3, LevelOfDetail=0)  # disabled
content_3 = ConstructSceneContent(Name=panel_9, Meshes=cluster_12.M, LevelOfDetail=0)  # disabled
panel_10 = Panel("""_pickup
_place
_home""")  # disabled
merge_7 = Merge(Data1=flatten(content), Data2=flatten(content_2), Data3=flatten(content_3))  # disabled
merge_8 = Merge(
    Data1=flatten(trajectory.TrajectoryObject),
    Data2=flatten(trajectory_2.TrajectoryObject),
    Data3=flatten(trajectory_3.TrajectoryObject))  # disabled
concat_2 = Concatenate(FragmentA=txt, FragmentB=panel_10)  # disabled
number_slider_2 = Slider(0, range=0..10)  # disabled
task_2 = ConstructTaskObject(
    TaskNames=concat_2,
    TargetDevices=data_3,
    RobotTrajectory=trajectory.TrajectoryObject,
    AssociatedSkill="null",
    EstimatedDuration=60)  # -> Output, TaskObject; disabled
number_slider_3 = Slider(300, range=0..1000)  # disabled
item_4 = ListItem(List=task_2.TaskObject, Index=number_slider_2, Wrap=True)  # disabled
toggle = BooleanToggle(False)  # disabled
simulator_2 = RobotSimulator(Robot=robot.RobotObject, RobotTask=item_4, StepInterval=number_slider_3, Start=toggle)  # -> Output, CurrentTCP, CurrentGeometry, ExternalAxis; disabled
panel_11 = Panel(simulator_2.CurrentTCP)  # disabled

# ----
# Virtual Robot Debugging
merge_9 = Merge(Data1=flatten(robot_trajectory.R), Data2=flatten(robot_trajectory.R_2), Data3=flatten(robot_trajectory.R_3))  # disabled
toggle_2 = BooleanToggle(True)  # disabled
scale_3 = Scale(Geometry=merge_9, Center=Point(0, 0, 0), Factor=1000)  # -> Geometry, Transform; disabled
panel_12 = Panel("1")  # disabled
iframe = InterpolateFrames(Frames=scale_3.Geometry, Length=path_point, Step=panel_12, Reset=toggle_2)  # -> Frame, Percent, CurrentIndex; disabled
robot_ik = RobotInverseKinematics(Robot=ur10, TargetTCPFrame=scale_3.Geometry, AxisToggles=[False, False, False], useColorPreview=True)  # -> PoseGeometry, AxisValues, AxisFrames; disabled
scale_4 = Scale(Geometry=iframe.Frame, Center=Point(0, 0, 0), Factor=0.001)  # -> Geometry, Transform; disabled

panel_13 = Panel(robot_ik.AxisValues)  # disabled
orient_2 = Orient(Geometry=brep_9, Source=robot_trajectory.pl_2, Target=scale_4.Geometry)  # -> Geometry, Transform; disabled
scale_5 = Scale(Geometry=robot_ik.PoseGeometry, Center=Point(0, 0, 0), Factor=0.001)  # -> Geometry, Transform; disabled

# ==== cluster Cluster
txt = ClusterInput()
col = ClusterInput()
data = ClusterInput()
M = ClusterInput()
col_2 = Colour(col)
data_2 = Data(data)
txt_2 = Text(txt)
yz = YZPlane(Origin=Point(0, 0, 0))
concat = Concatenate(FragmentA="dynamic_", FragmentB=txt_2)
mesh = SceneMeshObject(TargetAnchor=data_2, Meshes=M, Names=concat, Colours=col_2, DisplayRules="session")  # -> Output, MeshGeometryObjects
# Create Content Object
text = SceneTextObject(TargetAnchor=data_2, Texts=txt_2, Planes=yz, Names=txt_2, Colours=col_2, Solid=False, DisplayRules="session")  # -> Output, TextObjects
split = TextSplit(Text=txt_2, Separators="_")
item = ListItem(List=split, Index=0, Wrap=True)  # -> Item, Item1
content = ConstructSceneContent(Name=item.Item1, Meshes=mesh.MeshGeometryObjects, Texts=text.TextObjects, LevelOfDetail=0)  # -> flatten(ContentObject)
content_2 = ClusterOutput(content)
M_2 = ClusterOutput(mesh.MeshGeometryObjects)

# ==== cluster RobotTrajectory
pln = ClusterInput()
brep = ClusterInput()
pln_2 = ClusterInput()

# ---- group: pickup point
pln_3 = Plane(pln)

# ---- group: beam
brep_2 = Brep(brep)

# ---- group: home
pln_4 = Plane(pln_2)

# ---- group: placement point
debrep = DeconstructBrep(Brep=brep_2)  # -> Faces, Edges, Vertices
area = Area(Geometry=debrep.Faces)  # -> Area, Centroid
pdecon = Deconstruct(Point=area.Centroid)  # -> XComponent, YComponent, ZComponent
sort = SortList(Keys=pdecon.ZComponent, ValuesA=debrep.Faces)  # -> Keys, ValuesA
item = ListItem(List=reverse(sort.ValuesA), Index=0, Wrap=True)
debrep_2 = DeconstructBrep(Brep=item)  # -> Faces, Edges, Vertices
area_2 = Area(Geometry=item)  # -> Area, Centroid
len = Length(Curve=debrep_2.Edges)
sort_2 = SortList(Keys=len, ValuesA=debrep_2.Edges)  # -> Keys, ValuesA
item_2 = ListItem(List=sort_2.ValuesA, Index=0, Wrap=True)  # -> Item, Item1, Item2
py3 = Python3Script(line=item_2.Item)  # -> out, oLine; inputs line: Line
# ---------- py3: Python ----------
"""Grasshopper Script"""

import Rhino.Geometry as rg


start = line.PointAt(0)
end = line.PointAt(1)

if start.Y > end.Y:
    a = start
    b = end
else:
    a = end
    b = start

oLine = rg.Line(a, b)
# ---------- end py3 ----------
py3_2 = Python3Script(line=item_2.Item2)  # -> out, oLine; inputs line: Line
# ---------- py3_2: Python ----------
"""Grasshopper Script"""

import Rhino.Geometry as rg


start = line.PointAt(0)
end = line.PointAt(1)

if start.X > end.X:
    a = start
    b = end
else:
    a = end
    b = start

oLine = rg.Line(a, b)
# ---------- end py3_2 ----------
pl = ConstructPlane(Origin=area_2.Centroid, XAxis=py3.oLine, YAxis=py3_2.oLine)

# ----
Z = UnitZ(Factor="0.3")
move = Move(Geometry=pln_3, Motion=Z)  # -> Geometry, Transform
move_2 = Move(Geometry=pl, Motion=Z)  # -> Geometry, Transform
item_3 = ListItem(List=pln_4, Index=0, Wrap=True)
rev = ReverseList(List=pln_4)
pl_2 = ClusterOutput(pl)
merge = Merge(Data1=flatten(item_3), Data2=flatten(move.Geometry), Data3=flatten(pln_3))
merge_2 = Merge(
    Data1=flatten(pln_3),
    Data2=flatten(move.Geometry),
    Data3=flatten(pln_4),
    Data4=flatten(move_2.Geometry),
    Data5=flatten(pl))
merge_3 = Merge(Data1=flatten(pl), Data2=flatten(move_2.Geometry), Data3=flatten(rev))
R = ClusterOutput(merge)
R_2 = ClusterOutput(merge_2)
R_3 = ClusterOutput(merge_3)

# ==== cluster Cluster_2
B = ClusterInput()
relay = ClusterInput()
relay_2 = ClusterInput()
relay_3 = ClusterInput()
list = ValueList({"session", "step", "persistent", "flange"}, selected="flange")
list_2 = ValueList({"session", "step", "persistent", "flange"}, selected="session")
orient = Orient(Geometry=relay, Source=relay_2, Target=B)  # -> Geometry, Transform
orient_2 = Orient(Geometry=relay, Source=relay_2, Target=PlaneXY(0, 0, 0))  # -> Geometry, Transform
list_3 = ValueList({"session", "step", "persistent", "flange"}, selected="session")
mesh = SceneMeshObject(
    TargetAnchor=relay_3,
    Meshes=orient.Geometry,
    Names="pick-beam",
    Colours=ColourSwatch(SwatchColor=RGB(170, 240, 207)),
    DisplayRules=list_2)  # -> Output, MeshGeometryObjects
mesh_2 = SceneMeshObject(
    TargetAnchor=relay_3,
    Meshes=orient_2.Geometry,
    Names="ee-beam",
    Colours=ColourSwatch(SwatchColor=RGB(255, 117, 117)),
    DisplayRules=list)  # -> Output, MeshGeometryObjects
mesh_3 = SceneMeshObject(
    TargetAnchor=relay_3,
    Meshes=relay,
    Names="final-beam",
    Colours=ColourSwatch(SwatchColor=RGB(94, 219, 219)),
    DisplayRules=list_3)  # -> Output, MeshGeometryObjects
M = ClusterOutput(mesh_3.MeshGeometryObjects)
M_2 = ClusterOutput(mesh.MeshGeometryObjects)
M_3 = ClusterOutput(mesh_2.MeshGeometryObjects)

# ==== cluster Cluster_4
home = ClusterInput()
pickplane = ClusterInput()
brep = ClusterInput()
txt = ClusterInput()
data = ClusterInput()

brep_2 = Brep(brep)
txt_2 = Text(txt)
data_2 = Data(data)

robot_trajectory = RobotTrajectory_2(pln_2=home, pln=pickplane, brep=brep_2)  # -> R, R_2, R_3, pl_2
cartesian = BooleanToggle(True)
cluster = Cluster_3(relay_3=data_2, relay=brep_2, relay_2=robot_trajectory.pl_2, B=pickplane)  # -> M, M_2, M_3
trajectory = RobotTrajectoryObject(TargetRobot=data_2, IsCartesian=cartesian, TCPFrames=robot_trajectory.R, TrajectoryWidth=0.01)  # -> Output, TrajectoryObject, TrajectoryMesh
trajectory_2 = RobotTrajectoryObject(TargetRobot=data_2, IsCartesian=cartesian, TCPFrames=robot_trajectory.R_2, TrajectoryWidth=0.01)  # -> Output, TrajectoryObject, TrajectoryMesh
trajectory_3 = RobotTrajectoryObject(TargetRobot=data_2, IsCartesian=cartesian, TCPFrames=robot_trajectory.R_3, TrajectoryWidth=0.01)  # -> Output, TrajectoryObject, TrajectoryMesh
content = ConstructSceneContent(Name="content object", Meshes=cluster.M, LevelOfDetail=0)
content_2 = ConstructSceneContent(Name="content object", Meshes=cluster.M_2, LevelOfDetail=0)
content_3 = ConstructSceneContent(Name="content object", Meshes=cluster.M_3, LevelOfDetail=0)
robot = ClusterInput()

# ----
# Virtual Robot Debugging
number_slider = Slider(0.21, range=0.01..0.99)  # disabled
merge = Merge(Data1=robot_trajectory.R, Data2=robot_trajectory.R_2, Data3=robot_trajectory.R_3)  # disabled
toggle = BooleanToggle(True)  # disabled
scale = Scale(Geometry=merge, Center=Point(0, 0, 0), Factor=1000)  # -> Geometry, Transform; disabled
panel = Panel("1")  # disabled
iframe = InterpolateFrames(Frames=scale.Geometry, Length=number_slider, Step=panel, Reset=toggle)  # -> Frame, Percent, CurrentIndex; disabled
robot_ik = RobotInverseKinematics(Robot=robot, TargetTCPFrame=iframe.Frame, AxisToggles=[False, False, False], useColorPreview=True)  # -> PoseGeometry, AxisValues, AxisFrames; disabled
scale_2 = Scale(Geometry=iframe.Frame, Center=Point(0, 0, 0), Factor=0.001)  # -> Geometry, Transform; disabled
scale_3 = Scale(Geometry=robot_ik.PoseGeometry, Center=Point(0, 0, 0), Factor=0.001)  # -> Geometry, Transform; disabled
orient = Orient(Geometry=brep_2, Source=robot_trajectory.pl_2, Target=scale_2.Geometry)  # -> Geometry, Transform; disabled

panel_2 = Panel("""_pickup
_place
_home""")
merge_2 = Merge(
    Data1=flatten(trajectory.TrajectoryObject),
    Data2=flatten(trajectory_2.TrajectoryObject),
    Data3=flatten(trajectory_3.TrajectoryObject))
merge_3 = Merge(Data1=flatten(content), Data2=flatten(content_2), Data3=flatten(content_3))
concat = Concatenate(FragmentA=txt_2, FragmentB=panel_2)
task = ConstructTaskObject(
    TaskNames=concat,
    TargetDevices=data_2,
    SceneContents=merge_3,
    RobotTrajectory=merge_2,
    AssociatedSkill="null",
    EstimatedDuration=60)  # -> Output, TaskObject
task_2 = ClusterOutput(task.TaskObject)

# ==== cluster Cluster_5
brep = ClusterInput()
brep_2 = Brep(brep)
volume = Volume(Geometry=brep_2)  # -> Volume, Centroid
pdecon = Deconstruct(Point=volume.Centroid)  # -> XComponent, YComponent, ZComponent
sort = SortList(Keys=pdecon.XComponent, ValuesA=brep_2)  # -> Keys, ValuesA
item = ListItem(List=sort.ValuesA, Index=0, Wrap=True)  # -> Item, Item1, Item2
merge = Merge(Data1=item.Item1, Data2=item.Item2, Data3=item.Item)
R = ClusterOutput(merge)

# ==== cluster Cluster_6
brep = ClusterInput()
brep_2 = Brep(brep)
volume = Volume(Geometry=brep_2)  # -> Volume, Centroid
pdecon = Deconstruct(Point=volume.Centroid)  # -> XComponent, YComponent, ZComponent
sort = SortList(Keys=pdecon.XComponent, ValuesA=brep_2)  # -> Keys, ValuesA
item = ListItem(List=sort.ValuesA, Index=0, Wrap=True)  # -> Item, Item1, Item2
merge = Merge(Data1=item.Item, Data2=item.Item2, Data3=item.Item1)
R = ClusterOutput(merge)

# ==== cluster Cluster_7
B = ClusterInput()

# ---- group: placement point
debrep = DeconstructBrep(Brep=B)  # -> Faces, Edges, Vertices
area = Area(Geometry=debrep.Faces)  # -> Area, Centroid
pdecon = Deconstruct(Point=area.Centroid)  # -> XComponent, YComponent, ZComponent
sort = SortList(Keys=pdecon.ZComponent, ValuesA=debrep.Faces)  # -> Keys, ValuesA
item = ListItem(List=reverse(sort.ValuesA), Index=0, Wrap=True)
debrep_2 = DeconstructBrep(Brep=item)  # -> Faces, Edges, Vertices
area_2 = Area(Geometry=item)  # -> Area, Centroid
len = Length(Curve=debrep_2.Edges)
sort_2 = SortList(Keys=len, ValuesA=debrep_2.Edges)  # -> Keys, ValuesA
item_2 = ListItem(List=sort_2.ValuesA, Index=0, Wrap=True)  # -> Item, Item1, Item2
py3 = Python3Script(line=item_2.Item)  # -> out, oLine; inputs line: Line; same code as py3
py3_2 = Python3Script(line=item_2.Item2)  # -> out, oLine; inputs line: Line; same code as py3_2
pl = ConstructPlane(Origin=area_2.Centroid, XAxis=py3.oLine, YAxis=py3_2.oLine)
line = Line(item_2.Item2)

# ----
pl_2 = ClusterOutput(pl)
line_2 = ClusterOutput(line)

# ==== cluster Cluster_3
B = ClusterInput()
relay = ClusterInput()
relay_2 = ClusterInput()
relay_3 = ClusterInput()
list = ValueList({"session", "step", "persistent", "flange"}, selected="flange")
list_2 = ValueList({"session", "step", "persistent", "flange"}, selected="step")
orient = Orient(Geometry=relay, Source=relay_2, Target=B)  # -> Geometry, Transform
orient_2 = Orient(Geometry=relay, Source=relay_2, Target=PlaneXY(0, 0, 0))  # -> Geometry, Transform
list_3 = ValueList({"session", "step", "persistent", "flange"}, selected="session")
mesh = SceneMeshObject(
    TargetAnchor=relay_3,
    Meshes=orient.Geometry,
    Names="pick-beam",
    Colours=ColourSwatch(SwatchColor=RGB(170, 240, 207)),
    DisplayRules=list_2)  # -> Output, MeshGeometryObjects
mesh_2 = SceneMeshObject(
    TargetAnchor=relay_3,
    Meshes=orient_2.Geometry,
    Names="ee-beam",
    Colours=ColourSwatch(SwatchColor=RGB(255, 117, 117)),
    DisplayRules=list)  # -> Output, MeshGeometryObjects
mesh_3 = SceneMeshObject(
    TargetAnchor=relay_3,
    Meshes=relay,
    Names="final-beam",
    Colours=ColourSwatch(SwatchColor=RGB(94, 219, 219)),
    DisplayRules=list_3)  # -> Output, MeshGeometryObjects
M = ClusterOutput(mesh.MeshGeometryObjects)
M_2 = ClusterOutput(mesh_2.MeshGeometryObjects)
M_3 = ClusterOutput(mesh_3.MeshGeometryObjects)

# ==== cluster RobotTrajectory_2
pln = ClusterInput()
brep = ClusterInput()
pln_2 = ClusterInput()

# ---- group: pickup point
pln_3 = Plane(pln)

# ---- group: beam
brep_2 = Brep(brep)

# ---- group: home
pln_4 = Plane(pln_2)

# ---- group: placement point
debrep = DeconstructBrep(Brep=brep_2)  # -> Faces, Edges, Vertices
area = Area(Geometry=debrep.Faces)  # -> Area, Centroid
pdecon = Deconstruct(Point=area.Centroid)  # -> XComponent, YComponent, ZComponent
sort = SortList(Keys=pdecon.ZComponent, ValuesA=debrep.Faces)  # -> Keys, ValuesA
item = ListItem(List=reverse(sort.ValuesA), Index=0, Wrap=True)
debrep_2 = DeconstructBrep(Brep=item)  # -> Faces, Edges, Vertices
area_2 = Area(Geometry=item)  # -> Area, Centroid
len = Length(Curve=debrep_2.Edges)
sort_2 = SortList(Keys=len, ValuesA=debrep_2.Edges)  # -> Keys, ValuesA
item_2 = ListItem(List=sort_2.ValuesA, Index=0, Wrap=True)  # -> Item, Item1, Item2
py3 = Python3Script(line=item_2.Item)  # -> out, oLine; inputs line: Line; same code as py3
py3_2 = Python3Script(line=item_2.Item2)  # -> out, oLine; inputs line: Line; same code as py3_2
pl = ConstructPlane(Origin=area_2.Centroid, XAxis=py3.oLine, YAxis=py3_2.oLine)

# ----
pl_2 = ClusterOutput(pl)
Z = UnitZ(Factor="0.3")
move = Move(Geometry=pln_3, Motion=Z)  # -> Geometry, Transform
move_2 = Move(Geometry=pl, Motion=Z)  # -> Geometry, Transform
item_3 = ListItem(List=pln_4, Index=0, Wrap=True)
rev = ReverseList(List=pln_4)
merge = Merge(Data1=flatten(item_3), Data2=flatten(move.Geometry), Data3=flatten(pln_3))
merge_2 = Merge(
    Data1=flatten(pln_3),
    Data2=flatten(move.Geometry),
    Data3=flatten(pln_4),
    Data4=flatten(move_2.Geometry),
    Data5=flatten(pl))
merge_3 = Merge(Data1=flatten(pl), Data2=flatten(move_2.Geometry), Data3=flatten(rev))
R = ClusterOutput(merge)
R_2 = ClusterOutput(merge_2)
R_3 = ClusterOutput(merge_3)
